% Simulink data dictionary Battery_16Packs_1RC.sldd

CellType = 1
Ns_Module = 6
NumModules = 16

Battery = struct(
  SOC_LUT=[0.1378189; 0.2336168; 0.3294147; 0.4252126; 0.5210105; 0.6168084; 0.7126063; 0.8084042; 0.9042021; 1],
  Temperature_LUT=[278.15 293.15 323.15],
  Capacity_LUT=[310 310 310],
  Em_LUT=[3.495876 3.513261 3.515929
   3.558586 3.571954 3.572374
   3.607242 3.620683 3.627655
   3.647712 3.6576 3.666113
   3.693146 3.69761 3.706816
   3.755492 3.757733 3.766967
   3.841654 3.850835 3.866459
   3.951051 3.957725 3.966174
   4.063666 4.067089 4.072363
   4.190652 4.190612 4.191672],
  R0_LUT=[0.0009999981 0.0009693751 0.0007081459
   0.0009998564 0.0009112391 0.0007873589
   0.0009987303 0.0008946325 0.0008371746
   0.0009962629 0.0008794302 0.000835611
   0.0009872754 0.0008370281 0.0008207898
   0.0009995431 0.0007966578 0.0007837292
   0.0009901997 0.0008293178 0.0008431849
   0.0009947531 0.0008462239 0.0008577474
   0.0009888643 0.0008600463 0.0007838093
   0.0009935466 0.0008694306 0.0007610306],
  R1_LUT=[0.0004999478 0.0001764148 0.0003164036
   0.00049952 0.00018232 0.0002227583
   0.0004979423 0.0002156026 0.0001985157
   0.0004981172 0.0001900603 0.0001830198
   0.0004509405 0.0001789879 0.0001838038
   0.000398128 0.0001918548 0.0002074314
   0.0003766915 0.0001880084 0.0001986724
   0.0004191636 0.0002144337 0.0001619022
   0.000442604 0.0001552468 0.0002110344
   0.0004314838 0.0001549708 0.0002187277],
  C1_LUT=[1983.385 78841.49 1101.576
   4685.295 46429.68 4135.528
   9956.775 63356.41 12730.6
   11168.87 44437.72 12079.47
   4241.754 25121.86 9873.972
   4860.185 15430.16 2313.843
   8563.329 19567.71 8773.596
   11272.46 21732.15 11126.47
   3899.653 15798.99 2546.168
   2937.385 42171.32 1720.829],
  cell_mass=0.84,
  cell_rho_Cp=2040000,
  cell_Cp_heat=964.92,
  T_init=288.15,
  Qe_init=7.75,
  cell_area=0.101908,
  h_conv=5,
  R_bleed=20,
  TempInit=288.15,
  SOCInit=repmat(0.75, 1, 6),
  cond_thickness=0.001,
  thermal_conductivity=205)

Contactors_Cmd = Simulink.Bus(HeaderFile="Rte_Type.h")
  PosContactorChgrCmd: boolean
  PreChargeRelayChgrCmd: boolean
  NegContactorChgrCmd: boolean
  PosContactorInvtrCmd: boolean
  PreChargeRelayInvtrCmd: boolean
  NegContactorInvtrCmd: boolean

CurrentLimits = Simulink.Bus(HeaderFile="Rte_Type.h")
  DischargeCurrentLimit: single
  ChargeCurrentLimit: single

BMS_Cmd = Simulink.Bus(HeaderFile="Rte_Type.h")
  CurrentLimits_Bus: Bus: CurrentLimits
  ChargeCurrentReq: single
  ContactorsCmd_Bus: Bus: Contactors_Cmd
  BalCmd: boolean[1 96]

Sensors = Simulink.Bus(HeaderFile="Rte_Type.h")
  Cell_Voltages: single[96]
  Pack_Voltage: single
  Pack_Current: single
  Cell_Temperatures: single[96]
  Vout_Chgr: single
  Vout_Invtr: single